# Grasshopper definition HoppedUp_A_03_CultureInfoFormat.gh (Grasshopper 1.0.7)

doublex = GetNumber(Slider(0, range=0..10), AtLeast=1, AtMost=1, Maximum=1.797693135e+308, Minimum=-1.797693135e+308)
doubley = GetNumber(Slider(0, range=0..10), AtLeast=1, AtMost=1, Maximum=1.797693135e+308, Minimum=-1.797693135e+308)
a_03_cultureinfoformat = A_03_CultureInfoFormat(x=doublex, y=doubley)  # -> out, A; inputs x: Double, y: Double
# ---------- a_03_cultureinfoformat: C# ----------
    System.Globalization.CultureInfo uk = System.Globalization.CultureInfo.GetCultureInfo("en-GB");
    string formatted = string.Format(uk, "x: {0:P2}; y: {1:C2}", x, y);
    //P means percent and C means currency.
    // Following number stands for number of decimal places you want to show
    Print(formatted);
# ---------- end a_03_cultureinfoformat ----------

# ---- group: RH_OUT:text
text = Text(a_03_cultureinfoformat.out)

# ----
panel = Panel(text)
