# Grasshopper definition HoppedUp_D_09_ToggleSwitchAB.gh (Grasshopper 1.0.7)

d_09_toggleswitchab = D_09_ToggleSwitchAB()  # -> out, result; inputs toggle: Boolean
# ---------- d_09_toggleswitchab: C# ----------
    result = toggle ? valA : valB;
# ---------- end d_09_toggleswitchab ----------
